# Grasshopper definition sound_made_necklace3.gh (Grasshopper 1.0.7)

points = GetPoint(AtLeast=1, AtMost=2147483647, Realtime=True)
list_length = ListLength(List=points)
fit_line = FitLine(Points=points)
fit_line_2 = FitLine(Points=points)
list_length_2 = ListLength(List=points)
nurbs_curve = NurbsCurve(Vertices=points, Degree=Slider(1, range=0..10), Periodic=False)  # -> Curve, Length, Domain
nurbs_curve_2 = NurbsCurve(Vertices=points, Degree=Slider(5, range=0..10), Periodic=False)  # -> Curve, Length, Domain
rebuild_curve = RebuildCurve(Curve=nurbs_curve.Curve, Degree=Slider(3, range=0..10), Count=10, Tangents=False)
rebuild_curve_2 = RebuildCurve(Curve=nurbs_curve_2.Curve, Degree=Slider(2, range=0..10), Count=10, Tangents=False)
curve_closest_point = CurveClosestPoint(Point=points, Curve=rebuild_curve)  # -> Point, Parameter, Distance
curve = Curve(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)
curve_closest_point_2 = CurveClosestPoint(Point=points, Curve=rebuild_curve_2)  # -> Point, Parameter, Distance
curve_2 = Curve(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)
curve_frames = CurveFrames(Curve=curve, Count=list_length_2)  # -> Frames, Parameters
line = Line(StartPoint=points, EndPoint=curve_closest_point.Point)
curve_frames_2 = CurveFrames(Curve=curve_2, Count=list_length)  # -> Frames, Parameters
line_2 = Line(StartPoint=points, EndPoint=curve_closest_point_2.Point)
length = Length(Curve=line)
length_2 = Length(Curve=line_2)
line_sdl = LineSDL(Start=curve_frames.Frames, Direction=line, Length=length)
line_sdl_2 = LineSDL(Start=curve_frames_2.Frames, Direction=line_2, Length=length_2)
end_points = EndPoints(Curve=line_sdl)  # -> Start, End
end_points_2 = EndPoints(Curve=line_sdl_2)  # -> Start, End
nurbs_curve_3 = NurbsCurve(Vertices=end_points.End, Degree=3, Periodic=False)  # -> flatten(Curve), Length, Domain
nurbs_curve_4 = NurbsCurve(Vertices=end_points_2.End, Degree=3, Periodic=False)  # -> flatten(Curve), Length, Domain
tween_curve = TweenCurve(CurveA=nurbs_curve_3.Curve, CurveB=nurbs_curve_4.Curve, Factor=0.5, BlendType=0)
tween_curve_2 = TweenCurve(CurveA=nurbs_curve_3.Curve, CurveB=tween_curve, Factor=0.5, BlendType=0)
tween_curve_3 = TweenCurve(CurveA=tween_curve, CurveB=nurbs_curve_4.Curve, Factor=0.5, BlendType=0)
tween_curve_4 = TweenCurve(CurveA=tween_curve_3, CurveB=nurbs_curve_4.Curve, Factor=0.5, BlendType=0)
tween_curve_5 = TweenCurve(CurveA=tween_curve_2, CurveB=tween_curve, Factor=0.5, BlendType=0)
tween_curve_6 = TweenCurve(CurveA=nurbs_curve_3.Curve, CurveB=tween_curve_2, Factor=0.5, BlendType=0)
tween_curve_7 = TweenCurve(CurveA=tween_curve, CurveB=tween_curve_3, Factor=0.5, BlendType=0)
merge = Merge(
    Data1=tween_curve_6,
    Data2=tween_curve_2,
    Data3=tween_curve_5,
    Data4=tween_curve,
    Data5=tween_curve_7,
    Data6=tween_curve_3,
    Data7=tween_curve_4)
end_points_3 = EndPoints(Curve=merge)  # -> Start, End
graft_tree = GraftTree(Tree=merge, IncludeEmptyLists=True, IncludeNullItems=True)
perp_frames = PerpFrames(Curve=tween_curve_6, Count=Slider(1, range=0..10), Align=True)  # -> Frames, Parameters
list_item = ListItem(List=perp_frames.Frames, Index=Slider(1, range=0..1), Wrap=True)
polygon = Polygon(Plane=list_item, Radius=Slider(0.12, range=0.1..0.14), Segments=Slider(4, range=0..10), FilletRadius=0)  # -> Polygon, Length
rotate = Rotate(Geometry=polygon.Polygon, Angle=degrees(Slider(45, range=0..100)), Plane=list_item)  # -> Geometry, Transform
sweep1 = Sweep1(Rail=merge, Sections=rotate.Geometry, Miter=Slider(2, range=0..2))  # -> flatten(Brep)
brep = Brep(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)
cap_holes = CapHoles(Brep=sweep1)
trim_solid = TrimSolid(Shape=cap_holes, Cutters=brep)  # -> flatten(Result)
surface = Surface([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])
list_item_2 = ListItem(List=trim_solid, Index=0, Wrap=True)
list_item_3 = ListItem(List=trim_solid, Index=1, Wrap=True)
list_item_4 = ListItem(List=trim_solid, Index=2, Wrap=True)
list_item_5 = ListItem(List=trim_solid, Index=3, Wrap=True)
list_item_6 = ListItem(List=trim_solid, Index=4, Wrap=True)
list_item_7 = ListItem(List=trim_solid, Index=5, Wrap=True)
list_item_8 = ListItem(List=trim_solid, Index=6, Wrap=True)
cylinder = Cylinder(Base=surface, Radius=Slider(0.08, range=0..0.2), Length=Slider(1, range=0..1))
solid_difference = SolidDifference(BrepsA=list_item_7, BrepsB=list_item_8)
solid_difference_2 = SolidDifference(BrepsA=list_item_6, BrepsB=list_item_7)
solid_difference_3 = SolidDifference(BrepsA=list_item_2, BrepsB=list_item_3)
solid_difference_4 = SolidDifference(BrepsA=list_item_3, BrepsB=list_item_4)
solid_difference_5 = SolidDifference(BrepsA=list_item_4, BrepsB=list_item_5)
solid_difference_6 = SolidDifference(BrepsA=list_item_5, BrepsB=list_item_6)
solid_union = SolidUnion(Breps=[solid_difference_4, solid_difference_5])
solid_union_2 = SolidUnion(Breps=[solid_difference_6, solid_difference_2])
solid_union_3 = SolidUnion(Breps=[solid_difference, list_item_8])
solid_union_4 = SolidUnion(Breps=[solid_union, solid_difference_3])
solid_union_5 = SolidUnion(Breps=[solid_union_3, solid_union_2])
solid_union_6 = SolidUnion(Breps=[solid_union_4, solid_union_5])
solid_difference_7 = SolidDifference(BrepsA=solid_union_6, BrepsB=cylinder)
surface_2 = Surface(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)
mirror = Mirror(Geometry=solid_difference_7, Plane=surface_2)  # -> Geometry, Transform
mesh = Mesh([solid_difference_7, mirror.Geometry])
c_script = CSharpScript(mesh=mesh)  # -> base64Draco; inputs mesh: Mesh
# ---------- c_script: C# ----------
    var options = new Rhino.FileIO.DracoCompressionOptions();
    options.CompressionLevel = 5;
    options.IncludeTextureCoordinates = false;
    options.IncludeVertexColors = false;

    var compressed = Rhino.FileIO.DracoCompression.Compress(mesh, options);
    base64Draco = compressed.ToBase64String();
# ---------- end c_script ----------

# ---- group: RH_OUT:Mesh
txt = Text(c_script)
