# Grasshopper definition testesimples.gh (Grasshopper 1.0.7)

panel = Panel("""0,203.125,0
0.5865102639296188,203.125,0
1.1730205278592376,203.125,0
1.7595307917888565,203.125,0
2.346041055718475,203.125,0
2.932551319648094,203.125,0
3.5190615835777126,203.125,0
4.105571847507331,203.125,0
4.69208211143695,203.125,0
5.2785923753665696,203.125,0
5.865102639296189,203.125,0
6.451612903225808,203.125,0
7.038123167155427,204.6875,0
7.624633431085046,204.6875,0
8.211143695014664,204.6875,0
8.797653958944283,204.6875,0
9.3841642228739,204.6875,0
9.970674486803519,204.6875,0
10.557184750733137,204.6875,0
11.143695014662756,204.6875,0
11.730205278592374,204.6875,0
12.316715542521992,204.6875,0
12.90322580645161,204.6875,0
13.489736070381229,204.6875,0
14.076246334310847,204.6875,0
14.662756598240465,204.6875,0
15.249266862170083,204.6875,0
15.835777126099702,204.6875,0
16.42228739002932,204.6875,0
17.00879765395894,204.6875,0""")
points = GetPoint(panel, AtLeast=1, AtMost=2147483647, Realtime=True)
center_box = CenterBox(Base=points, X=1, Y=1, Z=1)
mesh = Mesh(center_box)
c_script = CSharpScript(mesh=mesh)  # -> base64Draco; inputs mesh: Mesh
# ---------- c_script: C# ----------
    var options = new Rhino.FileIO.DracoCompressionOptions();
    options.CompressionLevel = 5;
    options.IncludeTextureCoordinates = false;
    options.IncludeVertexColors = false;

    var compressed = Rhino.FileIO.DracoCompression.Compress(mesh, options);
    base64Draco = compressed.ToBase64String();
# ---------- end c_script ----------

# ---- group: RH_OUT:Mesh
txt = Text(c_script)
