# Grasshopper definition sound_made_necklace_simple.gh (Grasshopper 1.0.7)

sample2 = GetPoint(AtLeast=1, AtMost=2147483647, Realtime=True)
sample1 = GetPoint(AtLeast=1, AtMost=2147483647, Realtime=True)
construct_domain = ConstructDomain(DomainStart=Slider(0, range=0..100), DomainEnd=Slider(14, range=0..100))
construct_domain_2 = ConstructDomain(DomainStart=Slider(0, range=0..100), DomainEnd=Slider(14, range=0..100))
construct_domain_3 = ConstructDomain(DomainStart=Slider(0, range=0..100), DomainEnd=Slider(14, range=0..100))
construct_domain_4 = ConstructDomain(DomainStart=Slider(0, range=0..100), DomainEnd=Slider(14, range=0..100))
sub_list = SubList(Domain=construct_domain, Wrap=True)  # -> List, Index
sub_list_2 = SubList(List=sample2, Domain=construct_domain_2, Wrap=True)  # -> List, Index
sub_list_3 = SubList(Domain=construct_domain_3, Wrap=True)  # -> List, Index
sub_list_4 = SubList(List=sample1, Domain=construct_domain_4, Wrap=True)  # -> List, Index
vector_xyz = VectorXYZ(XComponent=sub_list_3.List, YComponent=sub_list.List, ZComponent=0)  # -> Vector, Length
vector_xyz_2 = VectorXYZ(XComponent=sub_list_4.List, YComponent=sub_list_2.List, ZComponent=0)  # -> Vector, Length
center_box = CenterBox(Base=vector_xyz_2.Vector, X=1, Y=1, Z=1)
list_length = ListLength(List=vector_xyz.Vector)
fit_line = FitLine(Points=vector_xyz.Vector)
fit_line_2 = FitLine(Points=vector_xyz.Vector)
list_length_2 = ListLength(List=vector_xyz.Vector)
nurbs_curve = NurbsCurve(Vertices=vector_xyz.Vector, Degree=Slider(1, range=0..10), Periodic=False)  # -> Curve, Length, Domain
mesh = Mesh(center_box)
nurbs_curve_2 = NurbsCurve(Vertices=vector_xyz.Vector, Degree=Slider(5, range=0..10), Periodic=False)  # -> Curve, Length, Domain
c_script = CSharpScript(mesh=mesh)  # -> base64Draco; inputs mesh: Mesh
# ---------- c_script: C# ----------
    var options = new Rhino.FileIO.DracoCompressionOptions();
    options.CompressionLevel = 5;
    options.IncludeTextureCoordinates = false;
    options.IncludeVertexColors = false;

    var compressed = Rhino.FileIO.DracoCompression.Compress(mesh, options);
    base64Draco = compressed.ToBase64String();
# ---------- end c_script ----------
rebuild_curve = RebuildCurve(Curve=nurbs_curve.Curve, Degree=Slider(3, range=0..10), Count=10, Tangents=False)
rebuild_curve_2 = RebuildCurve(Curve=nurbs_curve_2.Curve, Degree=Slider(2, range=0..10), Count=10, Tangents=False)

# ---- group: RH_OUT:Mesh
txt = Text(c_script)

# ----
curve_closest_point = CurveClosestPoint(Point=vector_xyz.Vector, Curve=rebuild_curve)  # -> Point, Parameter, Distance
curve = Curve(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)
curve_closest_point_2 = CurveClosestPoint(Point=vector_xyz.Vector, Curve=rebuild_curve_2)  # -> Point, Parameter, Distance
curve_2 = Curve(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)
curve_frames = CurveFrames(Curve=curve, Count=list_length_2)  # -> Frames, Parameters
line = Line(StartPoint=vector_xyz.Vector, EndPoint=curve_closest_point.Point)
curve_frames_2 = CurveFrames(Curve=curve_2, Count=list_length)  # -> Frames, Parameters
line_2 = Line(StartPoint=vector_xyz.Vector, EndPoint=curve_closest_point_2.Point)
length = Length(Curve=line)
length_2 = Length(Curve=line_2)
line_sdl = LineSDL(Start=curve_frames.Frames, Direction=line, Length=length)
line_sdl_2 = LineSDL(Start=curve_frames_2.Frames, Direction=line_2, Length=length_2)
end_points = EndPoints(Curve=line_sdl)  # -> Start, End
end_points_2 = EndPoints(Curve=line_sdl_2)  # -> Start, End
nurbs_curve_3 = NurbsCurve(Vertices=end_points.End, Degree=3, Periodic=False)  # -> flatten(Curve), Length, Domain
nurbs_curve_4 = NurbsCurve(Vertices=end_points_2.End, Degree=3, Periodic=False)  # -> flatten(Curve), Length, Domain
tween_curve = TweenCurve(CurveA=nurbs_curve_3.Curve, CurveB=nurbs_curve_4.Curve, Factor=0.5, BlendType=0)
tween_curve_2 = TweenCurve(CurveA=nurbs_curve_3.Curve, CurveB=tween_curve, Factor=0.5, BlendType=0)
tween_curve_3 = TweenCurve(CurveA=tween_curve, CurveB=nurbs_curve_4.Curve, Factor=0.5, BlendType=0)
tween_curve_4 = TweenCurve(CurveA=tween_curve_3, CurveB=nurbs_curve_4.Curve, Factor=0.5, BlendType=0)

perp_frames = PerpFrames(Curve=tween_curve_4, Count=Slider(1, range=0..10), Align=True)  # -> Frames, Parameters
list_item = ListItem(List=perp_frames.Frames, Index=Slider(1, range=0..1), Wrap=True)
polygon = Polygon(Plane=list_item, Radius=Slider(0.12, range=0.1..0.14), Segments=Slider(4, range=0..10), FilletRadius=0)  # -> Polygon, Length
rotate = Rotate(Geometry=polygon.Polygon, Angle=degrees(Slider(45, range=0..100)), Plane=list_item)  # -> Geometry, Transform
sweep1 = Sweep1(Rail=tween_curve_4, Sections=rotate.Geometry, Miter=Slider(2, range=0..2))  # -> flatten(Brep)
cap_holes = CapHoles(Brep=sweep1)

tween_curve_5 = TweenCurve(CurveA=tween_curve_2, CurveB=tween_curve, Factor=0.5, BlendType=0)

perp_frames_2 = PerpFrames(Curve=tween_curve_3, Count=Slider(1, range=0..10), Align=True)  # -> Frames, Parameters
list_item_2 = ListItem(List=perp_frames_2.Frames, Index=Slider(1, range=0..1), Wrap=True)
polygon_2 = Polygon(Plane=list_item_2, Radius=Slider(0.12, range=0.1..0.14), Segments=Slider(4, range=0..10), FilletRadius=0)  # -> Polygon, Length
rotate_2 = Rotate(Geometry=polygon_2.Polygon, Angle=degrees(Slider(45, range=0..100)), Plane=list_item_2)  # -> Geometry, Transform
sweep1_2 = Sweep1(Rail=tween_curve_3, Sections=rotate_2.Geometry, Miter=Slider(2, range=0..2))  # -> flatten(Brep)
cap_holes_2 = CapHoles(Brep=sweep1_2)

tween_curve_6 = TweenCurve(CurveA=nurbs_curve_3.Curve, CurveB=tween_curve_2, Factor=0.5, BlendType=0)

perp_frames_3 = PerpFrames(Curve=tween_curve_6, Count=Slider(1, range=0..10), Align=True)  # -> Frames, Parameters
list_item_3 = ListItem(List=perp_frames_3.Frames, Index=Slider(1, range=0..1), Wrap=True)
polygon_3 = Polygon(Plane=list_item_3, Radius=Slider(0.12, range=0.1..0.14), Segments=Slider(4, range=0..10), FilletRadius=0)  # -> Polygon, Length
rotate_3 = Rotate(Geometry=polygon_3.Polygon, Angle=degrees(Slider(45, range=0..100)), Plane=list_item_3)  # -> Geometry, Transform
sweep1_3 = Sweep1(Rail=tween_curve_6, Sections=rotate_3.Geometry, Miter=Slider(2, range=0..2))  # -> flatten(Brep)
cap_holes_3 = CapHoles(Brep=sweep1_3)

tween_curve_7 = TweenCurve(CurveA=tween_curve, CurveB=tween_curve_3, Factor=0.5, BlendType=0)
merge = Merge(
    Data1=tween_curve_6,
    Data2=tween_curve_2,
    Data3=tween_curve_5,
    Data4=tween_curve,
    Data5=tween_curve_7,
    Data6=tween_curve_3,
    Data7=tween_curve_4)

perp_frames_4 = PerpFrames(Curve=tween_curve_2, Count=Slider(1, range=0..10), Align=True)  # -> Frames, Parameters
list_item_4 = ListItem(List=perp_frames_4.Frames, Index=Slider(1, range=0..1), Wrap=True)
polygon_4 = Polygon(Plane=list_item_4, Radius=Slider(0.12, range=0.1..0.14), Segments=Slider(4, range=0..10), FilletRadius=0)  # -> Polygon, Length
rotate_4 = Rotate(Geometry=polygon_4.Polygon, Angle=degrees(Slider(45, range=0..100)), Plane=list_item_4)  # -> Geometry, Transform
sweep1_4 = Sweep1(Rail=tween_curve_2, Sections=rotate_4.Geometry, Miter=Slider(2, range=0..2))  # -> flatten(Brep)
cap_holes_4 = CapHoles(Brep=sweep1_4)

perp_frames_5 = PerpFrames(Curve=tween_curve, Count=Slider(1, range=0..10), Align=True)  # -> Frames, Parameters
list_item_5 = ListItem(List=perp_frames_5.Frames, Index=Slider(1, range=0..1), Wrap=True)
polygon_5 = Polygon(Plane=list_item_5, Radius=Slider(0.12, range=0.1..0.14), Segments=Slider(4, range=0..10), FilletRadius=0)  # -> Polygon, Length
rotate_5 = Rotate(Geometry=polygon_5.Polygon, Angle=degrees(Slider(45, range=0..100)), Plane=list_item_5)  # -> Geometry, Transform
sweep1_5 = Sweep1(Rail=tween_curve, Sections=rotate_5.Geometry, Miter=Slider(2, range=0..2))  # -> flatten(Brep)
cap_holes_5 = CapHoles(Brep=sweep1_5)

perp_frames_6 = PerpFrames(Curve=tween_curve_5, Count=Slider(1, range=0..10), Align=True)  # -> Frames, Parameters
list_item_6 = ListItem(List=perp_frames_6.Frames, Index=Slider(1, range=0..1), Wrap=True)
polygon_6 = Polygon(Plane=list_item_6, Radius=Slider(0.12, range=0.1..0.14), Segments=Slider(4, range=0..10), FilletRadius=0)  # -> Polygon, Length
rotate_6 = Rotate(Geometry=polygon_6.Polygon, Angle=degrees(Slider(45, range=0..100)), Plane=list_item_6)  # -> Geometry, Transform
sweep1_6 = Sweep1(Rail=tween_curve_5, Sections=rotate_6.Geometry, Miter=Slider(2, range=0..2))  # -> flatten(Brep)
cap_holes_6 = CapHoles(Brep=sweep1_6)

perp_frames_7 = PerpFrames(Curve=tween_curve_7, Count=Slider(1, range=0..10), Align=True)  # -> Frames, Parameters
list_item_7 = ListItem(List=perp_frames_7.Frames, Index=Slider(1, range=0..1), Wrap=True)
polygon_7 = Polygon(Plane=list_item_7, Radius=Slider(0.12, range=0.1..0.14), Segments=Slider(4, range=0..10), FilletRadius=0)  # -> Polygon, Length
rotate_7 = Rotate(Geometry=polygon_7.Polygon, Angle=degrees(Slider(45, range=0..100)), Plane=list_item_7)  # -> Geometry, Transform
sweep1_7 = Sweep1(Rail=tween_curve_7, Sections=rotate_7.Geometry, Miter=Slider(2, range=0..2))  # -> flatten(Brep)
cap_holes_7 = CapHoles(Brep=sweep1_7)

surface = Surface(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)
mirror = Mirror(Geometry=[cap_holes_6, cap_holes_4, cap_holes_3, cap_holes_5, cap_holes_7, cap_holes_2, cap_holes], Plane=surface)  # -> Geometry, Transform
mesh_2 = Mesh([mirror.Geometry, cap_holes_3, cap_holes_4, cap_holes_6, cap_holes_5, cap_holes_7, cap_holes_2, cap_holes])
c_script_2 = CSharpScript(mesh=mesh_2)  # -> base64Draco; inputs mesh: Mesh; same code as c_script
